% Simulink data dictionary SparkBat.sldd

OCV = [265.3014 276.2755 285.8836 294.2709 301.5708 307.9054 313.3864 318.1156 322.1856 325.6803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 395.3091]
OCV_SoC = [0 1 2 3 4 5 6 7 8 9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 100]
R_Charge = [0.079 0.0755 0.0723 0.0701 0.0682 0.0669 0.0656 0.065 0.0643 0.064 0.0634]
R_Discharge = [0.0902 0.0819 0.0765 0.0733 0.071 0.0694 0.0682 0.0669 0.0659 0.0653 0.0656]
SOC = []
soc_init = 0.8
SOC_R_Charge = [0 0.1 0.2 0.3 0.4 0.5 0.6 0.7 0.8 0.9 1]
SOC_R_Discharge = [0 0.1 0.2 0.3 0.4 0.5 0.6 0.7 0.8 0.9 1]
batt_soc_max = 0.9
batt_cap_init = 80