% Simulink data dictionary VirtualVehicleTemplate.sldd
% references SiMappedEngine.sldd
% references SiEngine.sldd
% references SiEngineCore.sldd
% references SiEngineCoreV.sldd
% references SiEngineCoreNA.sldd
% references SiDLEngine.sldd
% references SimpleEngine.sldd
% references CiEngineCore.sldd
% references CiMappedEngine.sldd
% references SiEngineController.sldd
% references CiEngineController.sldd
% references BatteryDCDC.sldd
% references Drivetrain.sldd
% references ElectricMachine1.sldd
% references ElectricMachine2.sldd
% references FuelCellElectricSystem.sldd
% references PassVeh.sldd
% references Trailer.sldd
% references HevPxVCU.sldd
% references HevIpsVCU.sldd
% references HevMmVCU.sldd
% references VehicleConfig.sldd
% references Driver.sldd
% references Environment.sldd
% references Scenario.sldd
% references EvVCU.sldd
% references SiDynoReferenceApplication.sldd
% references SparkEM.sldd
% references SparkBat.sldd

ScnFHSteerAmp = 540
PlntVehDstHtchRear = 1
PlntSpKCLatLdTrnsfr = [0 0 0 0]
PlntSpKCRollCamber = [0 0]
PlntSpKCRollCaster = [0 0]
PlntSpKCRollSteer = [0 0]
PlntSpKCRollStiffArbFrnt = 0
PlntSpKCRollStiffNoArbFrnt = 0
PlntSpKCRollStiffNoTwstRear = 0